# Grasshopper definition weightsPreview.gh (Grasshopper 1.0.7)
# plug-ins: treesloth01, Pufferfish, Human, Dodo, MetaHopper, Wombat

file = ReadFile(File="C:\Users\MartinPetrov\PycharmProjects\pythonProject1\weight.csv", PerLineParse=True)
join = TextJoin(Text=file, Join=",")
split = TextSplit(Text=join, Separators="[[")
panel = Panel(file)
clean = CleanTree(RemoveNulls=True, RemoveInvalid=True, RemoveEmpty=False, Tree=split)
serieslist = SeriesFromList(List=split, Start=0, Step=1)
len = TextLength(Text=split)
dispatch = Dispatch(List=serieslist, DispatchPattern=len)  # -> ListA, ListB
shiftboth = ShiftListBothWays(List=dispatch.ListB, ShiftOffset=1, Wrap=False)  # -> ListA, ListB
subtraction = Subtraction(A=shiftboth.ListB, B=shiftboth.ListA)
partition = PartitionList(List=split, Size=subtraction)
panel_2 = Panel(clean)
cull_i = CullIndex(List=partition, Indices=Slider(0, range=0..100), Wrap=True)  # -> simplify(List)
clean_2 = CleanTree(RemoveNulls=True, RemoveInvalid=True, RemoveEmpty=invert(False), Tree=cull_i)
split_2 = TextSplit(Text=clean_2, Separators=" ")
split_3 = TextSplit(Text=split_2, Separators="],")
len_2 = TextLength(Text=split_3)
dispatch_2 = Dispatch(List=split_3, DispatchPattern=len_2)  # -> ListA, ListB
clean_3 = CleanTree(RemoveNulls=True, RemoveInvalid=True, RemoveEmpty=invert(False), Tree=dispatch_2.ListA)
shift = ShiftPaths(Data=clean_3, Offset=-1)
lng = ListLength(List=shift)
avr = Average(Input=lng)
shift_2 = ShiftPaths(Data=avr, Offset=-1)
number_slider = Slider(10, range=0..10)
avr_2 = Average(Input=shift_2)
renumber = RenumberPaths(Data=avr_2)
branch = TreeBranch(Tree=simplify(renumber), Path=Slider(0, range=0..100), MaintainPaths=True)
wrap = WrapList(Data=renumber)
wrap_2 = WrapList(Data=branch)
merge = Merge(Data1=flatten(wrap_2), Data2=flatten(wrap))
unwrap = UnwrapList(WrappedData=merge)
series = Series(Start=0, Step="2", Count=unwrap)
subtraction_2 = Subtraction(A=series, B=unwrap)  # -> simplify(Result)
renumber_2 = RenumberPaths(Data=subtraction_2)
tstat = TreeStatistics(Tree=renumber_2)  # -> Paths, Length, Count
serieslist_2 = SeriesFromList(List=tstat.Length, Start=0, Step=Slider(13, range=0..100))
pt = ConstructPoint(XCoordinate=graft(serieslist_2), YCoordinate=renumber_2, ZCoordinate=0)  # -> simplify(Point)
panel_3 = Panel(avr_2)
wrap_3 = WrapList(Data=pt)  # -> flatten(WrappedData)
shiftboth_2 = ShiftListBothWays(List=wrap_3, ShiftOffset=1, Wrap=False)  # -> ListA, ListB
panel_4 = Panel(renumber_2)
unwrap_2 = UnwrapList(WrappedData=shiftboth_2.ListA)  # -> simplify(UnwrappedData)
unwrap_3 = UnwrapList(WrappedData=shiftboth_2.ListB)  # -> simplify(UnwrappedData)
lng_2 = ListLength(List=unwrap_3)
crossref = CrossReference(ListA=unwrap_2, ListB=unwrap_3, CrossMode=1)  # -> ListA, ListB
data = Data(shift)
ln = Line(StartPoint=simplify(crossref.ListA), EndPoint=simplify(crossref.ListB))
wrap_4 = WrapList(Data=data)
partition_2 = PartitionList(List=ln, Size=lng_2)
shift_3 = ShiftPaths(Data=wrap_4, Offset=-1)
wrap_5 = WrapList(Data=shift_3)  # -> flatten(WrappedData)
wrap_6 = WrapList(Data=partition_2)
unwrapn = UnwrapListNLevels(Data=wrap_5, Levels=0)  # -> simplify(Data)
shift_4 = ShiftPaths(Data=wrap_6, Offset=-1)
reparamnums = ReparameterizeNumbers(Numbers=flatten(unwrapn), Invert=False)  # -> Reparameterized, Original
wrap_7 = WrapList(Data=shift_4)  # -> flatten(WrappedData)
unflatten = UnflattenTree(Tree=reparamnums.Reparameterized, Guide=unwrapn)
gradient = Gradient(LowerLimit=0, UpperLimit=1, Parameter=unflatten, stops=[0.448: RGB(204, 255, 153), 1: RGB(255, 0, 0)])
unwrapn_2 = UnwrapListNLevels(Data=wrap_7, Levels=0)  # -> simplify(Data)
smaller = SmallerThan(FirstNumber=unflatten, SecondNumber=Slider(0.7, range=0..1))  # -> SmallerThan, OrEqualTo
cull = CullPattern(List=unwrapn_2, CullPattern=invert(smaller.OrEqualTo))
cull_2 = CullPattern(List=gradient, CullPattern=invert(smaller.OrEqualTo))
preview = CustomPreview(Geometry=cull, Material=cull_2)
multiplication = Multiplication(A=unflatten, B=Slider(3, range=0..10))
cull_3 = CullPattern(List=gradient, CullPattern=invert(smaller.OrEqualTo))
cull_4 = CullPattern(List=multiplication, CullPattern=invert(smaller.OrEqualTo))
previewlw = CustomPreviewLineweights(Geometry=cull, Shader=cull_3, Thickness=cull_4, Absolute=False)
